# Grasshopper definition coffee-diamond.gh (Grasshopper 1.0.7)
# plug-ins: LunchBox

number_slider = Slider(70, range=40..70)
number_slider_2 = Slider(20, range=10..20)
construct_point = ConstructPoint(XCoordinate=0, YCoordinate=0, ZCoordinate=0)
construct_point_2 = ConstructPoint(XCoordinate=0, YCoordinate=0, ZCoordinate=Slider(100, range=80..100))
number_slider_3 = Slider(60, range=40..60)
addition = Addition(A=number_slider_2, B=Slider(1.5, range=0..100))
number_slider_4 = Slider(4, range=0..10)
addition_2 = Addition(A=number_slider, B=Slider(1.5, range=0..100))
point = Point(construct_point)
point_2 = Point(construct_point_2)
division = Division(A=number_slider_4, B="2")
circle = Circle(Plane=point_2, Radius=addition_2)
circle_2 = Circle(Plane=point_2, Radius=number_slider)
circle_3 = Circle(Plane=point, Radius=number_slider_2)
circle_4 = Circle(Plane=point, Radius=number_slider_3)
circle_5 = Circle(Plane=point, Radius=addition)
construct_point_3 = ConstructPoint(XCoordinate=0, YCoordinate=0, ZCoordinate=division)
number_slider_5 = Slider(50, range=0..100)
point_3 = Point(construct_point_3)
merge = Merge(Data1=circle_2, Data2=circle_3)
boundary_surfaces = BoundarySurfaces(Edges=circle_4)
merge_2 = Merge(Data1=circle, Data2=circle_5)
unit_z = UnitZ(Factor=number_slider_4)
circle_6 = Circle(Plane=point_3, Radius=number_slider_3)
loft = Loft(Curves=merge, Options={Adjust=False, Closed=False, LoftEnds=0, LoftSimp=0, LoftType=0, Rebuild=10, Refit=0.01})
loft_2 = Loft(Curves=merge_2, Options={Adjust=False, Closed=False, LoftEnds=0, LoftSimp=0, LoftType=0, Rebuild=10, Refit=0.01})
extrude = Extrude(Base=boundary_surfaces, Direction=unit_z)
merge_3 = Merge(Data1=circle_3, Data2=circle_5)
merge_4 = Merge(Data1=circle, Data2=circle_2)
pipe = Pipe(Curve=circle_6, Radius=division, Caps=0)
surface = Surface(loft)
surface_2 = Surface(loft_2)
diamond_panels = DiamondPanels(Surface=surface, UDivisions=Slider(10, range=0..10), VDivisions=Slider(30, range=20..50))  # -> DiamondPanels, TriPanels
surface_3 = Surface(diamond_panels.DiamondPanels)
surface_4 = Surface(diamond_panels.TriPanels)
cap_holes = CapHoles(Brep=surface_2)
merge_5 = Merge(Data2=surface_3, Data3=surface_4)
solid_difference = SolidDifference(BrepsA=extrude, BrepsB=cap_holes)
brep_join = BrepJoin(Breps=merge_5)  # -> Breps, Closed
cap_holes_2 = CapHoles(Brep=brep_join.Breps)
solid_difference_2 = SolidDifference(BrepsA=solid_difference, BrepsB=cap_holes_2)
solid_difference_3 = SolidDifference(BrepsA=cap_holes, BrepsB=cap_holes_2)
merge_6 = Merge(Data1=solid_difference_3, Data2=solid_difference_2, Data3=pipe)
solid_union = SolidUnion(Breps=merge_6)
custom_preview = CustomPreview(Geometry=solid_union, Material=ColourSwatch(SwatchColor=RGB(139, 140, 133)))
