# Grasshopper definition coffee-rib.gh (Grasshopper 1.0.7)

height = Slider(70, range=0..100)
point2 = Slider(69, range=0..100)
point1 = Slider(30, range=0..100)
number_slider = Slider(55, range=0..100)
number_slider_2 = Slider(15, range=0..100)
number_slider_3 = Slider(2.5, range=0..100)
larger_than = LargerThan(FirstNumber=point2, SecondNumber=height)  # -> LargerThan, OrEqualTo
smaller_than = SmallerThan(FirstNumber=point1, SecondNumber=point2)  # -> SmallerThan, OrEqualTo
smaller_than_2 = SmallerThan(FirstNumber=point1, SecondNumber=height)  # -> SmallerThan, OrEqualTo
number_slider_4 = Slider(5, range=0..10)
construct_point = ConstructPoint(XCoordinate=0, YCoordinate=0, ZCoordinate=0)
construct_point_2 = ConstructPoint(XCoordinate=0, YCoordinate=0, ZCoordinate=height)
number_slider_5 = Slider(42, range=0..100)
subtraction = Subtraction(A=point2, B="20")
addition = Addition(A=number_slider_2, B=number_slider_3)
addition_2 = Addition(A=number_slider, B=number_slider_3)
point = Point(construct_point)
point_2 = Point(construct_point_2)
gate_or = GateOr(A=smaller_than_2.OrEqualTo, B=smaller_than.SmallerThan)
division = Division(A=number_slider_4, B="2")
stream_filter = StreamFilter(Gate=larger_than.LargerThan, Stream0=point2, Stream1=height)
circle = Circle(Plane=point_2, Radius=addition_2)
circle_2 = Circle(Plane=point_2, Radius=number_slider)
stream_filter_2 = StreamFilter(Gate=gate_or, Stream0=subtraction, Stream1=point1)
circle_3 = Circle(Plane=point, Radius=number_slider_2)
circle_4 = Circle(Plane=point, Radius=number_slider_5)
circle_5 = Circle(Plane=point, Radius=addition)
construct_point_3 = ConstructPoint(XCoordinate=0, YCoordinate=0, ZCoordinate=division)
construct_point_4 = ConstructPoint(XCoordinate=0, YCoordinate=0, ZCoordinate=stream_filter_2)
construct_point_5 = ConstructPoint(XCoordinate=0, YCoordinate=0, ZCoordinate=stream_filter)
point_3 = Point(construct_point_3)
merge = Merge(Data1=circle_2, Data2=circle_3)
boundary_surfaces = BoundarySurfaces(Edges=circle_4)
merge_2 = Merge(Data1=circle, Data2=circle_5)
unit_z = UnitZ(Factor=number_slider_4)
circle_6 = Circle(Plane=point_3, Radius=number_slider_5)
merge_3 = Merge(Data1=construct_point_5, Data2=construct_point_4)
loft = Loft(Curves=merge, Options={Adjust=False, Closed=False, LoftEnds=0, LoftSimp=0, LoftType=0, Rebuild=10, Refit=0.01})
loft_2 = Loft(Curves=merge_2, Options={Adjust=False, Closed=False, LoftEnds=0, LoftSimp=0, LoftType=0, Rebuild=10, Refit=0.01})
extrude = Extrude(Base=boundary_surfaces, Direction=unit_z)
interpolate = Interpolate(Vertices=merge_3, Degree=3, Periodic=False, KnotStyle=1)  # -> Curve, Length, Domain
merge_4 = Merge(Data1=circle_3, Data2=circle_5)
merge_5 = Merge(Data1=circle, Data2=circle_2)
pipe = Pipe(Curve=circle_6, Radius=division, Caps="0")
surface = Surface(loft)
surface_2 = Surface(loft_2)
unit_x = UnitX(Factor=1)
flatten_tree = FlattenTree(Path="{0}")
array_count = Slider(14, range=2..20)
project = Project(Curve=interpolate.Curve, Brep=surface, Direction=unit_x)
polar_array = PolarArray(Geometry=project, Plane=PlaneXY(0, 0, 0), Count=array_count, Angle=6.283185307)  # -> Geometry, Transform
cap_holes = CapHoles(Brep=surface_2)
solid_difference = SolidDifference(BrepsA=extrude, BrepsB=cap_holes)
pipe_2 = Pipe(Curve=polar_array.Geometry, Radius=Slider(2, range=0..10), Caps="2")
cap_holes_2 = CapHoles(Brep=surface)
solid_difference_2 = SolidDifference(BrepsA=solid_difference, BrepsB=cap_holes_2)
brep = Brep(pipe_2)
solid_intersection = SolidIntersection(BrepsA=cap_holes_2, BrepsB=brep)
solid_difference_3 = SolidDifference(BrepsA=cap_holes, BrepsB=cap_holes_2)
flatten_tree_2 = FlattenTree(Tree=solid_intersection, Path="{0}")
merge_6 = Merge(Data1=solid_difference_3, Data2=solid_difference_2, Data3=pipe)
brep_join = BrepJoin(Breps=merge_6)  # -> Breps, Closed
solid_union = SolidUnion(Breps=merge_6)
flatten_tree_3 = FlattenTree(Tree=solid_union, Path="{0}")
merge_7 = Merge(Data1=flatten_tree_2, Data2=brep_join.Breps)
brep_join_2 = BrepJoin(Breps=merge_7)  # -> Breps, Closed
custom_preview = CustomPreview(Geometry=brep_join_2.Breps, Material=ColourSwatch(SwatchColor=RGB(139, 140, 133)))
