# Grasshopper definition coffee-wavy.gh (Grasshopper 1.0.7)

number_slider = Slider(61, range=0..100)
number_slider_2 = Slider(20, range=0..100)
construct_point = ConstructPoint(XCoordinate=0, YCoordinate=0, ZCoordinate=0)
construct_point_2 = ConstructPoint(XCoordinate=0, YCoordinate=0, ZCoordinate=Slider(82, range=0..100))
addition = Addition(A=number_slider_2, B=Slider(1.5, range=0..100))
number_slider_3 = Slider(4, range=0..10)
addition_2 = Addition(A=number_slider, B=Slider(1.5, range=0..100))
point = Point(construct_point)
point_2 = Point(construct_point_2)
division = Division(A=number_slider_3, B="2")
circle = Circle(Plane=point_2, Radius=addition_2)
circle_2 = Circle(Plane=point_2, Radius=number_slider)
circle_3 = Circle(Plane=point, Radius=number_slider_2)
circle_4 = Circle(Plane=point, Radius=Slider(50, range=0..100))
circle_5 = Circle(Plane=point, Radius=addition)
construct_point_3 = ConstructPoint(XCoordinate=0, YCoordinate=0, ZCoordinate=division)
unit_z = UnitZ(Factor=1)
point_3 = Point(construct_point_3)
boundary_surfaces = BoundarySurfaces(Edges=circle_4)
merge = Merge(Data1=circle, Data2=circle_5)
unit_z_2 = UnitZ(Factor=number_slider_3)
circle_6 = Circle(Plane=point_3, Radius=Slider(50, range=0..100))
loft = Loft(Curves=merge, Options={Adjust=False, Closed=False, LoftEnds=0, LoftSimp=0, LoftType=0, Rebuild=10, Refit=0.01})
contour = Contour(Shape=loft, Point=Point(0, 0, 0), Direction=unit_z, Distance=Slider(15, range=0..100))
offset_curve = OffsetCurve(Curve=contour, Distance=Slider(1.5, range=0..100), Corners=1)
extrude = Extrude(Base=boundary_surfaces, Direction=unit_z_2)
divide_curve = DivideCurve(Curve=contour, Count=Slider(30, range=0..100), Kinks=False)  # -> Points, Tangents, Parameters
merge_2 = Merge(Data1=circle_3, Data2=circle_5)
merge_3 = Merge(Data1=circle, Data2=circle_2)
list_length = ListLength(List=flatten(contour))
area = Area(Geometry=contour)  # -> Area, Centroid
pipe = Pipe(Curve=circle_6, Radius=division, Caps=0)
flatten_tree = FlattenTree(Tree=offset_curve, Path="{0}")
range = Range(Domain=Domain(0, 1), Steps=expr("x-1", list_length))
loft_2 = Loft(Curves=flatten_tree, Options={Adjust=False, Closed=False, LoftEnds=0, LoftSimp=0, LoftType=0, Rebuild=10, Refit=0.01})
dispatch = Dispatch(List=divide_curve.Points, DispatchPattern=[True, False])  # -> ListA, ListB
surface = Surface(loft_2)
graph_mapper = GraphMapper(range, x0=0, x1=1, y0=0, y1=1, container_name="Gaussian", factor=0.4829764962, mean=0.5, sdev=0.453814961)
point_4 = Point(dispatch.ListA)
point_5 = Point(dispatch.ListB)
cap_holes = CapHoles(Brep=surface)
solid_difference = SolidDifference(BrepsA=extrude, BrepsB=cap_holes)
construct_domain = ConstructDomain(DomainStart=Slider(1, range=0..1), DomainEnd=Slider(0.923, range=0..1))
bounds = Bounds(Numbers=graph_mapper)
remap_numbers = RemapNumbers(Value=graph_mapper, Source=bounds, Target=construct_domain)  # -> Mapped, Clipped
graft_tree = GraftTree(Tree=remap_numbers.Mapped, IncludeEmptyLists=True, IncludeNullItems=True)
scale = Scale(Geometry=point_4, Center=area.Centroid, Factor=graft_tree)  # -> Geometry, Transform
weave = Weave(Pattern=[0, 1], Stream0=scale.Geometry, Stream1=point_5, NullGaps=False)
interpolate = Interpolate(Vertices=weave, Degree=3, Periodic=Toggle(True), KnotStyle=1)  # -> Curve, Length, Domain
angle = Slider(180, range=0..360)
flatten_tree_2 = FlattenTree(Tree=interpolate.Curve, Path="{0}")
list_length_2 = ListLength(List=flatten_tree_2)
range_2 = Range(Domain=angle, Steps=expr("x-1", list_length_2))
graph_mapper_2 = GraphMapper(
    range_2,
    x0=0,
    x1=90,
    y0=0,
    y1=90,
    container_name="Bezier",
    cpx=[0, 0.09403575212, 0.9488636255, 1],
    cpy=[0, 0.58051759, 0.4515507221, 1])
rotate = Rotate(Geometry=flatten_tree_2, Angle=degrees(graph_mapper_2), Plane=PlaneXY(0, 0, 0))  # -> Geometry, Transform
loft_3 = Loft(Curves=rotate.Geometry, Options={Adjust=False, Closed=False, LoftEnds=0, LoftSimp=0, LoftType=0, Rebuild=10, Refit=0.01})
cap_holes_2 = CapHoles(Brep=loft_3)
solid_difference_2 = SolidDifference(BrepsA=solid_difference, BrepsB=cap_holes_2)
solid_difference_3 = SolidDifference(BrepsA=cap_holes, BrepsB=cap_holes_2)
merge_4 = Merge(Data1=solid_difference_3, Data2=solid_difference_2, Data3=pipe)
solid_union = SolidUnion(Breps=merge_4)
custom_preview = CustomPreview(Geometry=solid_union, Material=ColourSwatch(SwatchColor=RGB(139, 140, 133)))
